# Grasshopper definition 015_load_mesh.ghx (Grasshopper 1.0.7)

path = FilePath()
python = GhPythonScript(path=path)  # -> out, a
# ---------- python: Python ----------
import compas
import compas.datastructures as cd
import compas_ghpython.artists as artist

mesh = cd.Mesh.from_json(path)
a = artist.MeshArtist(mesh).draw()
# ---------- end python ----------
