# Grasshopper definition raccoon_kuka_robot_cell_.ghx (Grasshopper 1.0.7)
# plug-ins: KUKA|prc - parametric robot control

box = Box({Plane=PlaneXY(2774.25562, 395.3575118, 1675.017761), X=Domain(0, 1000), Y=Domain(0, 1000), Z=Domain(-1000, 0)})
edges = BrepEdges(Brep=box)  # -> Naked, Interior, NonManifold

# ----
# Common Settings
# Robot model
# Rail length
# East Robot (Master)
# West Robot (Slave)
# In most cases, adjusting these
# parameters is unnecessary.
panel = Panel("0")
frame = FrameKUKAPrc(FrameNumber=0, XValue=panel, YValue="-2400", ZValue="0", AValue="0", BValue="0", CValue="0", toolaxis="Z")  # -> KUKAPrcFrame, XYZABCAsPlane
frame_2 = FrameKUKAPrc(FrameNumber=0, XValue="37.5", YValue="2403", ZValue="-2.000", AValue="0.181", BValue="0", CValue="0", toolaxis="Z")  # -> KUKAPrcFrame, XYZABCAsPlane
# raccoon KUKA robot cell template
# v0.2
kr90_kr270_r2500 = QuantecKR90KR270R2500Robot(infiniterot=False)
east_platform_mesh = Mesh(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)
west_platform_mesh = Mesh(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)
east_rail_mesh = Mesh(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)
west_rail_mesh = Mesh(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)
deplane = DeconstructPlane(Plane=frame.XYZABCAsPlane)  # -> Origin, XAxis, YAxis, ZAxis
deplane_2 = DeconstructPlane(Plane=frame_2.XYZABCAsPlane)  # -> Origin, XAxis, YAxis, ZAxis
custom_rail = CustomLinearAxisKUKAPrc(
    KUKAPrcRobotInput=kr90_kr270_r2500,
    RobotRail=east_rail_mesh,
    RobotPlatform=east_platform_mesh,
    PositiveLength="4270",
    NegativeLength="0",
    PositiveDirection=deplane.XAxis,
    RobotBase=frame.XYZABCAsPlane)
custom_rail_2 = CustomLinearAxisKUKAPrc(
    KUKAPrcRobotInput=kr90_kr270_r2500,
    RobotRail=west_rail_mesh,
    RobotPlatform=west_platform_mesh,
    PositiveLength="4270",
    NegativeLength="0",
    PositiveDirection=deplane_2.XAxis,
    RobotBase=frame_2.XYZABCAsPlane)

point = Point([Point(3463.061171, 1242.783245, 1148.031447), Point(3179.929925, 984.0718167, 992.7012096), Point(3053.51693, 843.6342015, 1363.237565)])

# ---- group: In Box?
brepinc = PointInBrep(Brep=box, Point=point, Strict=False)
not = GateNot(A=brepinc)
int = Integer(not)
ma = MassAddition(Input=int)  # -> Result, PartialResults
larger = LargerThan(FirstNumber=ma.Result, SecondNumber="0")  # -> LargerThan, OrEqualTo
filter = StreamFilter(Gate=larger.LargerThan, Stream0=point)

# ---- group: Gripper
gripper_mesh = Mesh(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)
custom_tool = CustomToolKUKAPrc(
    CustomToolGeometry=gripper_mesh,
    toolid=4,
    toolvala=0,
    toolvalb=-90,
    toolvalc=0,
    toolvalx=0,
    toolvaly=0,
    toolvalz=360,
    valuesset=True)

# ----
# Process Definition
axis_move = AXISMovementKUKAPrc(
    Axis1=Slider(30.17, range=-180..180),
    Axis2=Slider(-99.57, range=-180..180),
    Axis3=Slider(86.48, range=-180..180),
    Axis4=Slider(0.8, range=-180..180),
    Axis5=Slider(27.72, range=-180..180),
    Axis6=Slider(-23.68, range=-180..180),
    ExternalAxis1=Slider(2656, range=0..4270),
    extaxenabled=True,
    interpolation="C_PTP")

# ---- group: Flange
# Tool Definition
custom_tool_2 = CustomToolKUKAPrc(toolid=3, toolvala=0, toolvalb=0, toolvalc=0, toolvalx=0, toolvaly=0, toolvalz=0, valuesset=True)

# ----
# East robot
number_slider = Slider(0, range=0..1)
kuka_prc = KUKAPrcCORE(
    SimulationSlider=number_slider,
    KUKAPrcCommands=axis_move,
    Tool=custom_tool_2,
    Robot=custom_rail,
    SaveToggle=Button(),
    Filename="E_",
    PRC_BaseExpose=False,
    PRC_SaveNameExpose=True,
    PRCsettings="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")  # -> RobotGeometry, AnalysisOutput

pl = ConstructPlane(Origin=filter, XAxis="0,-1,0", YAxis="-1,0,0")
ptp_movement_kuka_prc = PTPMovementKUKAPrc(TargetAsPlane=pl, ExternalAxis1="3140", extaxenabled=True, interpolation="C_PTP")

# ----
# West robot
number_slider_2 = Slider(0, range=0..1)
kuka_prc_2 = KUKAPrcCORE(
    SimulationSlider=number_slider_2,
    KUKAPrcCommands=ptp_movement_kuka_prc,
    Tool=custom_tool_2,
    Robot=custom_rail_2,
    SaveToggle=Button(),
    Filename="W_",
    PRC_BaseExpose=False,
    PRC_SaveNameExpose=True,
    PRCsettings="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")  # -> RobotGeometry, AnalysisOutput
