# Grasshopper definition rccn_led.ghx (Grasshopper 1.0.7)
# plug-ins: KUKA|prc - parametric robot control

# ----
# Common Settings
# Robot model
# Rail length
# East Robot (Master)
# West Robot (Slave)
# In most cases, adjusting these
# parameters is unnecessary.
panel = Panel("-2400")
frame = FrameKUKAPrc(FrameNumber=0, XValue="0", YValue=panel, ZValue="0", AValue="0", BValue="0", CValue="0", toolaxis="Z")  # -> KUKAPrcFrame, XYZABCAsPlane
frame_2 = FrameKUKAPrc(FrameNumber=0, XValue="37.5", YValue="2403", ZValue="-2.000", AValue="0.181", BValue="0", CValue="0", toolaxis="Z")  # -> KUKAPrcFrame, XYZABCAsPlane
# raccoon KUKA robot cell template
# v0.2
kr90_kr270_r2500 = QuantecKR90KR270R2500Robot(infiniterot=False)
east_platform_mesh = Mesh(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)
west_platform_mesh = Mesh(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)
east_rail_mesh = Mesh(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)
west_rail_mesh = Mesh(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)
deplane = DeconstructPlane(Plane=frame.XYZABCAsPlane)  # -> Origin, XAxis, YAxis, ZAxis
deplane_2 = DeconstructPlane(Plane=frame_2.XYZABCAsPlane)  # -> Origin, XAxis, YAxis, ZAxis
custom_rail = CustomLinearAxisKUKAPrc(
    KUKAPrcRobotInput=kr90_kr270_r2500,
    RobotRail=east_rail_mesh,
    RobotPlatform=east_platform_mesh,
    PositiveLength="4270",
    NegativeLength="0",
    PositiveDirection=deplane.XAxis,
    RobotBase=frame.XYZABCAsPlane)
custom_rail_2 = CustomLinearAxisKUKAPrc(
    KUKAPrcRobotInput=kr90_kr270_r2500,
    RobotRail=west_rail_mesh,
    RobotPlatform=west_platform_mesh,
    PositiveLength="4270",
    NegativeLength="0",
    PositiveDirection=deplane_2.XAxis,
    RobotBase=frame_2.XYZABCAsPlane)

# ---- group: Gripper
gripper_mesh = Mesh(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)
custom_tool = CustomToolKUKAPrc(
    CustomToolGeometry=gripper_mesh,
    toolid=4,
    toolvala=0,
    toolvalb=-90,
    toolvalc=0,
    toolvalx=0,
    toolvaly=0,
    toolvalz=360,
    valuesset=True)

# ---- group: Flange
# Tool Definition
custom_tool_2 = CustomToolKUKAPrc(toolid=3, toolvala=0, toolvalb=0, toolvalc=0, toolvalx=0, toolvaly=0, toolvalz=0, valuesset=True)

# ----
# Process Definition
axis_move = AXISMovementKUKAPrc(Axis1=0, Axis2=-90, Axis3=90, Axis4=0, Axis5=0, Axis6=0, extaxenabled=True, interpolation="C_PTP")

# ----
# East robot
number_slider = Slider(0, range=0..1)
kuka_prc = KUKAPrcCORE(
    SimulationSlider=number_slider,
    KUKAPrcCommands=axis_move,
    Tool=custom_tool_2,
    Robot=custom_rail,
    SaveToggle=Button(),
    Filename="E_",
    PRC_BaseExpose=False,
    PRC_SaveNameExpose=True,
    PRCsettings="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")  # -> RobotGeometry, AnalysisOutput

crv = Curve(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)

box = Box({Plane=PlaneXY(2774.25562, 395.3575118, 1675.017761), X=Domain(0, 1000), Y=Domain(0, 1000), Z=Domain(-1000, 0)})
edges = BrepEdges(Brep=box)  # -> Naked, Interior, NonManifold

crv_2 = Curve(crv)
pt = Point(Point(3319.777684, 852.4675641, 1188.552909))
move_curve = GhPythonScript(Curve=crv_2, Target_pt=pt, Scale=Slider(11.57, range=0..34), Angle=Slider(-21.44, range=-180..180))  # -> Target_curve; inputs Curve: Curve, Target_pt: Point3d
# ---------- move_curve: Python ----------
import rhinoscriptsyntax as rs
xsum = []
ysum = []
zsum = []
box = rs.BoundingBox(Curve)
for i in range(len(box)):
    xsum.append(box[i][0])
    ysum.append(box[i][1])
    zsum.append(box[i][2])
center = rs.AddPoint(sum(xsum)/len(box),sum(ysum)/len(box),sum(zsum)/len(box))
scaled = rs.ScaleObject(Curve,center,(Scale,Scale,Scale))
rotated = rs.RotateObject(scaled,center,Angle,(0,0,1))
Target_curve = rs.MoveObject(rotated,rs.VectorCreate(Target_pt,center))
# ---------- end move_curve ----------

led = GhPythonScript(color=Slider(0, range=0..7), mode=Slider(1, range=0..7), item=Slider(0, range=0..7))  # -> LEDcmd; inputs color: Int32, mode: Int32, item: Int32
# ---------- led: Python ----------
import rhinoscriptsyntax as rs

LEDcmd = []
LEDcmd.append('userColor='+str(color))
LEDcmd.append('userMode='+str(mode))
LEDcmd.append('userItem='+str(item))
# ---------- end led ----------
krl_code = KRLCodeKUKAPrc(KRLAsText=led)

ccolor = GhPythonScript(R=Slider(100, range=0..255), G=Slider(100, range=0..255), B=Slider(100, range=0..255))  # -> Color; inputs R: Int32, G: Int32, B: Int32
# ---------- ccolor: Python ----------
import rhinoscriptsyntax as rs

Color = []
Color.append('userR='+str(R))
Color.append('userG='+str(G))
Color.append('userB='+str(B))
# ---------- end ccolor ----------
krl_code_2 = KRLCodeKUKAPrc(KRLAsText=ccolor)

topoly = CurveToPolyline(Curve=move_curve, ToleranceDistance=Slider(2.61, range=0..10), ToleranceAngle=Slider(3.77, range=0..10))  # -> Polyline, Segments
cpoly = ControlPolygon(Curve=topoly.Polyline)  # -> Polygon, Points

# ---- group: In Box?
brepinc = PointInBrep(Brep=box, Point=cpoly.Points, Strict=False)
not = GateNot(A=brepinc)
int = Integer(not)
ma = MassAddition(Input=int)  # -> Result, PartialResults
larger = LargerThan(FirstNumber=ma.Result, SecondNumber="0")  # -> LargerThan, OrEqualTo
filter = StreamFilter(Gate=larger.LargerThan, Stream0=cpoly.Points)

# ----
pl = ConstructPlane(Origin=filter, XAxis="0,-1,0", YAxis="-1,0,0")
lng = ListLength(List=pl)
lng_2 = ListLength(List=pl)
number_slider_2 = Slider(179, range=0..255)
range = Range(Domain=Slider(255, range=0..1000), Steps=expr("x-1", lng))  # -> reverse(Range)
range_2 = Range(Domain=Slider(255, range=0..1000), Steps=expr("x-1", lng_2))

led_2 = GhPythonScript(color=Slider(0, range=0..7), mode=Slider(1, range=0..7), item=Slider(0, range=0..7))  # -> LEDcmd; inputs color: Int32, mode: Int32, item: Int32; same code as led
krl_code_3 = KRLCodeKUKAPrc(KRLAsText=led_2)

# ---- group: Reset LED values
led_3 = GhPythonScript(color="0", mode="0", item="0")  # -> LEDcmd; inputs color: Int32, mode: Int32, item: Int32; same code as led
krl_code_4 = KRLCodeKUKAPrc(KRLAsText=led_3)

# ----
ccolor_2 = GhPythonScript(R=range_2, G=range, B=number_slider_2)  # -> Color; inputs R: Int32, G: Int32, B: Int32; same code as ccolor
krl_code_5 = KRLCodeKUKAPrc(KRLAsText=ccolor_2)  # -> simplify(KUKAPrcCommand)

ptp_move = PTPMovementKUKAPrc(TargetAsPlane=pl, Speed=Slider(80, range=0..100), extaxenabled=False, interpolation="C_PTP")
split = SplitList(List=ptp_move, Index="1")  # -> ListA, simplify(graft(ListB))
merge = Merge(Data1=krl_code_5, Data2=split.ListB)
msphere = MeshSphere(Base=pl, Radius=Slider(75, range=0..100), UCount=10, VCount=20)
rgb = ColourRGB(Alpha=255, Red=range_2, Green=range, Blue=number_slider_2)
entwine = Entwine(Branch00=split.ListA, Branch01=krl_code_3, Branch02=merge, Branch03=krl_code_4, FlattenInputs=True)  # -> flatten(Result)

# ----
# West robot
number_slider_3 = Slider(0, range=0..1)
mesh = Mesh(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)
custom_tool_3 = CustomToolKUKAPrc(
    CustomToolGeometry=mesh,
    toolid=3,
    toolvala=0,
    toolvalb=0,
    toolvalc=0,
    toolvalx=0,
    toolvaly=0,
    toolvalz=0,
    valuesset=True)
kuka_prc_2 = KUKAPrcCORE(
    SimulationSlider=number_slider_3,
    KUKAPrcCommands=entwine,
    Tool=custom_tool_3,
    Robot=custom_rail_2,
    SaveToggle=Button(),
    Filename="rccn_LED_",
    PRC_BaseExpose=False,
    PRC_SaveNameExpose=True,
    PRCsettings="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")  # -> RobotGeometry, AnalysisOutput

preview = CustomPreview(Geometry=msphere, Material=rgb)
