# Grasshopper definition 207_robot_artist_grasshopper.ghx (Grasshopper 1.0.7)

reload = Button()

# ---- group: set config
# Configuration
a3 = Slider(120, range=-120..155)
a6 = Slider(0, range=-350..350)
a2 = Slider(-140, range=-140..-5)
a1 = Slider(0, range=-185..185)
a2_2 = Slider(-140, range=-140..-5)
a4 = Slider(0, range=-350..350)
a5 = Slider(122, range=-122..122)
e1 = Slider(1084, range=0..4270)
a1_2 = Slider(0, range=-185..185)
a3_2 = Slider(120, range=-120..155)
a4_2 = Slider(0, range=-350..350)
a5_2 = Slider(-22, range=-122..122)
a6_2 = Slider(0, range=-350..350)
e1_2 = Slider(1084, range=0..4270)
config = PythonScript(
    e_a1=a1,
    e_a2=a2_2,
    e_a3=a3,
    e_a4=a4,
    e_a5=a5,
    e_a6=a6,
    e_e1=e1,
    w_a1=a1_2,
    w_a2=a2,
    w_a3=a3_2,
    w_a4=a4_2,
    w_a5=a5_2,
    w_a6=a6_2,
    w_e1=e1_2)  # -> config
# ---------- config: Python ----------
import math
from compas.robots import Configuration
from compas.robots import Joint

joint_values=[e_e1/1000, math.radians(e_a1),math.radians(e_a2),math.radians(e_a3),math.radians(e_a4),math.radians(e_a5),math.radians(e_a6), w_e1/1000, math.radians(w_a1),math.radians(w_a2),math.radians(w_a3),math.radians(w_a4),math.radians(w_a5),math.radians(w_a6)]
joint_names=["east_joint_e1", "east_joint_a1", "east_joint_a2", "east_joint_a3", "east_joint_a4", "east_joint_a5", "east_joint_a6", "west_joint_a1", "west_joint_a2", "west_joint_a3", "west_joint_a4", "west_joint_a5", "west_joint_a6", "west_joint_e1"]
joint_types=[Joint.REVOLUTE, Joint.REVOLUTE, Joint.REVOLUTE, Joint.REVOLUTE, Joint.REVOLUTE, Joint.REVOLUTE, Joint.PRISMATIC, Joint.REVOLUTE, Joint.REVOLUTE, Joint.REVOLUTE, Joint.REVOLUTE, Joint.REVOLUTE, Joint.REVOLUTE, Joint.PRISMATIC]

config = Configuration(joint_values, joint_types, joint_names)
# ---------- end config ----------

# ----
python = GhPythonScript()  # -> file, path; inputs filename: list
# ---------- python: Python ----------
"""
Get the path of files in the same folder with this GH file.
If filename is omitted, this will return the path of this GH file.
Please configure the Grasshopper component's parameters as the following:
Input:
    - filename: list_access, type_hint: str
Output:
    - path
    - file
"""

import Grasshopper
import os

filepath = ghenv.Component.OnPingDocument().FilePath
path = os.path.dirname(filepath)
if filename:
    path = os.path.join(path, *filename)


file = None
if os.path.isfile(path):
    with open(path) as f:
        file = f.readlines()
# ---------- end python ----------

# ----
# Robot
load = Button()
python_2 = PythonScript(path=python.path, load=load)  # -> out, model, artist
# ---------- python_2: Python ----------
from scriptcontext import sticky as st

import compas
import compas_fab

from compas.robots import LocalPackageMeshLoader
from compas.robots import RobotModel
from compas_ghpython.artists import RobotModelArtist

# Robot meshes are usually in meters
# Set a high percision to prevent parsing errors
# and configure Rhino itself in meters
compas.PRECISION = '12f'

# Store robot in component-based key
model_key = 'model_{}'.format(str(ghenv.Component.InstanceGuid))
artist_key = 'artist_{}'.format(str(ghenv.Component.InstanceGuid))

if model_key not in st:
    st[model_key] = None
if artist_key not in st:
    st[artist_key] = None

if load:
    
    # Prepare loader
    loader = LocalPackageMeshLoader(path, 'rccn_kuka_robot_cell')

    # Create robot model from URDF
    model = RobotModel.from_urdf_file(loader.load_urdf('rccn_kuka_robot_cell.urdf'))

    # Load geometry
    model.load_geometry(loader)

    artist = RobotModelArtist(model)

    st[model_key] = model
    st[artist_key] = artist

model = st[model_key]
artist = st[artist_key]
# ---------- end python_2 ----------

py = PythonScript(reload=reload)
# ---------- py: Python ----------
if reload:
    from compas_ghpython import unload_modules
    unload_modules('compas')
# ---------- end py ----------

# ----
# Visualisation
visualize = GhPythonScript(model=python_2.model, artist=python_2.artist, config=config)  # -> out, a
# ---------- visualize: Python ----------
joint_names = [j.name for j in model.get_configurable_joints()]
config.joint_names = joint_names
artist.update(config.joint_dict)
a = artist.draw_visual()
# ---------- end visualize ----------

medges = MeshEdges(Mesh=visualize.a)  # -> NakedEdges, InteriorEdges, NonManifoldEdges
